# Grasshopper definition hops.gh (Grasshopper 1.0.7)
# plug-ins: treesloth01

input_data_moreobjectives_lessheight = Number(Tree({0;0;0}: [4, 17, 82, -41, 39, 41, 23, 73, 2, 116, 67, 106, 0.84, 0.5, 0.03, 0.27, 0.7, 0.8, 0.6, 0.8, 8, 7, 2, 10, 3, 2, 2, 2], {0;1;0}: [4, 41, 41, -36, 27, 69, 69, 3, 7, 16, 128, 144, 1.5, 2.78, 2.23, 1.47, 0.8, 0.4, 0.5, 0.1, 7, 6, 6, 10, 1, 3, 2, 0], {0;2;0}: [8, 17, 41, 42, 60, 44, 9, 6, 26, 12, 80, 83, 2.88, 0.27, 2.36, 2.43, 0.1, 0.6, 0.5, 0.7, 9, 3, 6, 3, 3, 4, 4, 4], {0;3;0}: [6, 90, 80, -29, 42, 31, 66, 33, 139, 8, 39, 95, 0.53, 2.72, 1.17, 2.43, 0.7, 0.2, 0.3, 0.8, 4, 4, 0, 2, 4, 0, 3, 5], {0;4;0}: [5, 47, 54, -21, 31, 75, 88, 89, 114, 100, 117, 31, 0.48, 1.5, 2.16, 1.04, 0.7, 0.3, 0.6, 0.8, 5, 7, 9, 5, 2, 4, 3, 4], {0;5;0}: [7, 44, 63, -27, 30, 48, 89, 6, 38, 36, 136, 79, 2.72, 1.08, 2.86, 1.66, 0, 0.1, 0.7, 0.8, 9, 10, 1, 7, 3, 1, 5, 3]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))
input_data_moreobjectives2 = Number(Tree({0;0;0}: [8, 95, 42, -22, 69, 12, 11, 71, 161, 125, 472, 142, 1.96, 1.4, 1.93, 2.11, 0.2, 0.3, 0.7, 0.7, 0, 4, 6, 8, 5, 1, 0, 2], {0;1;0}: [8, 32, 99, 3, 69, 89, 86, 68, 137, 412, 403, 218, 1.16, 1.67, 0.19, 1.42, 0.6, 0.1, 0.4, 0.3, 5, 2, 7, 7, 5, 3, 2, 0], {0;2;0}: [7, 46, 21, -17, 80, 9, 10, 43, 499, 475, 108, 51, 0.66, 2.92, 0.94, 2.87, 0.3, 0.4, 0.1, 0.4, 5, 1, 2, 5, 4, 5, 4, 0], {0;3;0}: [7, 60, 87, -24, 31, 39, 10, 48, 437, 181, 387, 64, 0.37, 1.11, 0.08, 1.11, 0.4, 0.2, 0.7, 0.2, 9, 2, 4, 0, 2, 0, 2, 4], {0;4;0}: [10, 53, 87, -30, 14, 85, 94, 9, 11, 70, 350, 147, 0.22, 2.99, 1.62, 2.78, 0.6, 0, 0.8, 0.8, 7, 1, 2, 3, 0, 5, 4, 3], {0;5;0}: [4, 26, 67, -24, 19, 21, 4, 36, 311, 160, 120, 342, 1.76, 2.23, 1.7, 1.6, 0.7, 0.3, 0.6, 0.3, 2, 1, 3, 2, 3, 4, 5, 3]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))
input_data_first_run = Number(Tree({0;0;0}: [8, 95, 42, -22, 69, 12, 11, 71, 161, 125, 472, 142, 1.96, 1.4, 1.93, 2.11, 0.2, 0.3, 0.7, 0.7, 0, 4, 6, 8, 5, 1, 0, 2], {0;1;0}: [8, 32, 99, 3, 69, 89, 86, 68, 137, 412, 403, 218, 1.16, 1.67, 0.19, 1.42, 0.6, 0.1, 0.4, 0.3, 5, 2, 7, 7, 5, 3, 2, 0], {0;2;0}: [7, 46, 21, -17, 80, 9, 10, 43, 499, 475, 108, 51, 0.66, 2.92, 0.94, 2.87, 0.3, 0.4, 0.1, 0.4, 5, 1, 2, 5, 4, 5, 4, 0], {0;3;0}: [7, 60, 87, -24, 31, 39, 10, 48, 437, 181, 387, 64, 0.37, 1.11, 0.08, 1.11, 0.4, 0.2, 0.7, 0.2, 9, 2, 4, 0, 2, 0, 2, 4], {0;4;0}: [10, 53, 87, -30, 14, 85, 94, 9, 11, 70, 350, 147, 0.22, 2.99, 1.62, 2.78, 0.6, 0, 0.8, 0.8, 7, 1, 2, 3, 0, 5, 4, 3], {0;5;0}: [4, 26, 67, -24, 19, 21, 4, 36, 311, 160, 120, 342, 1.76, 2.23, 1.7, 1.6, 0.7, 0.3, 0.6, 0.3, 2, 1, 3, 2, 3, 4, 5, 3]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))
renumber = RenumberPaths(Data=input_data_moreobjectives2)
branch = TreeBranch(Tree=renumber, Path=Slider(104, range=101..110), MaintainPaths=True)
item = ListItem(List=branch, Index="1", Wrap=True)
item_2 = ListItem(List=branch, Index="0", Wrap=True)
item_3 = ListItem(List=branch, Index="2", Wrap=True)
item_4 = ListItem(List=branch, Index="3", Wrap=True)
item_5 = ListItem(List=branch, Index="4", Wrap=True)
item_6 = ListItem(List=branch, Index="5", Wrap=True)
item_7 = ListItem(List=branch, Index="6", Wrap=True)
item_8 = ListItem(List=branch, Index="7", Wrap=True)
item_9 = ListItem(List=branch, Index="8", Wrap=True)
item_10 = ListItem(List=branch, Index="9", Wrap=True)
item_11 = ListItem(List=branch, Index="10", Wrap=True)
item_12 = ListItem(List=branch, Index="11", Wrap=True)
item_13 = ListItem(List=branch, Index="12", Wrap=True)
item_14 = ListItem(List=branch, Index="13", Wrap=True)
item_15 = ListItem(List=branch, Index="14", Wrap=True)
item_16 = ListItem(List=branch, Index="15", Wrap=True)
item_17 = ListItem(List=branch, Index="16", Wrap=True)
item_18 = ListItem(List=branch, Index="17", Wrap=True)
item_19 = ListItem(List=branch, Index="18", Wrap=True)
item_20 = ListItem(List=branch, Index="19", Wrap=True)
item_21 = ListItem(List=branch, Index="20", Wrap=True)
item_22 = ListItem(List=branch, Index="21", Wrap=True)
item_23 = ListItem(List=branch, Index="22", Wrap=True)
item_24 = ListItem(List=branch, Index="23", Wrap=True)
item_25 = ListItem(List=branch, Index="24", Wrap=True)
item_26 = ListItem(List=branch, Index="25", Wrap=True)
item_27 = ListItem(List=branch, Index="26", Wrap=True)
item_28 = ListItem(List=branch, Index="27", Wrap=True)
multiplication = Multiplication(A=item_2, B="5/3")
multiplication_2 = Multiplication(A=item_4, B="-0.5")
division = Division(A=item_3, B="3")
division_2 = Division(A=item, B="3")
# insert hops component
# insert inputs
# see predictions
panel = Panel("http://c8b1-34-80-252-147.ngrok.io/hello3")
panel_2 = Panel("0")
merge = Merge()
# Predicted Daylight
panel_3 = Panel(merge)
# Honeybee Daylight
panel_4 = Panel("""75
78
28""")
subtraction = Subtraction(A=panel_3, B=panel_4)
# Error
panel_5 = Panel(subtraction)
division_3 = Division(A=panel_5, B=panel_4)
multiplication_3 = Multiplication(A=division_3, B="100")
# % Error
panel_6 = Panel(multiplication_3)
