# Grasshopper definition volumeMassing.gh (Grasshopper 1.0.7)

minxy = Slider(13, range=0..50)
maxxy = Slider(50, range=0..50)
minlength = Slider(20, range=20..50)
maxlength = Slider(50, range=20..50)
minwidth = Slider(20, range=20..50)
maxwidth = Slider(100, range=20..150)
minangle = Slider(0, range=0..180)
maxangle = Slider(180, range=0..180)
minheight = Slider(20, range=20..50)
mindistance = Slider(20, range=20..70)
maxdistance = Slider(66, range=20..70)
maxheight = Slider(50, range=20..50)
count = Slider(10, range=1..10)
minxy_2 = GetNumber(minxy, AtLeast=1, AtMost=1, Maximum=1.797693135e+308, Minimum=-1.797693135e+308)
maxxy_2 = GetNumber(maxxy, AtLeast=1, AtMost=1, Maximum=1.797693135e+308, Minimum=-1.797693135e+308)
minlength_2 = GetNumber(minlength, AtLeast=1, AtMost=1, Maximum=1.797693135e+308, Minimum=-1.797693135e+308)
maxlength_2 = GetNumber(maxlength, AtLeast=1, AtMost=1, Maximum=1.797693135e+308, Minimum=-1.797693135e+308)
minwidth_2 = GetNumber(minwidth, AtLeast=1, AtMost=1, Maximum=1.797693135e+308, Minimum=-1.797693135e+308)
maxwidth_2 = GetNumber(maxwidth, AtLeast=1, AtMost=1, Maximum=1.797693135e+308, Minimum=-1.797693135e+308)
minangle_2 = GetNumber(minangle, AtLeast=1, AtMost=1, Maximum=1.797693135e+308, Minimum=-1.797693135e+308)
maxangle_2 = GetNumber(maxangle, AtLeast=1, AtMost=1, Maximum=1.797693135e+308, Minimum=-1.797693135e+308)
minheight_2 = GetNumber(minheight, AtLeast=1, AtMost=1, Maximum=1.797693135e+308, Minimum=-1.797693135e+308)
maxheight_2 = GetNumber(maxheight, AtLeast=1, AtMost=1, Maximum=1.797693135e+308, Minimum=-1.797693135e+308)
mindistance_2 = GetNumber(mindistance, AtLeast=1, AtMost=1, Maximum=1.797693135e+308, Minimum=-1.797693135e+308)
maxdistance_2 = GetNumber(maxdistance, AtLeast=1, AtMost=1, Maximum=1.797693135e+308, Minimum=-1.797693135e+308)
count_2 = GetNumber(count, AtLeast=1, AtMost=1, Maximum=1.797693135e+308, Minimum=-1.797693135e+308)
dom = ConstructDomain(DomainStart=minxy_2, DomainEnd=maxxy_2)
dom_2 = ConstructDomain(DomainStart=minlength_2, DomainEnd=maxlength_2)
dom_3 = ConstructDomain(DomainStart=minwidth_2, DomainEnd=maxwidth_2)
dom_4 = ConstructDomain(DomainStart=minangle_2, DomainEnd=maxangle_2)
dom_5 = ConstructDomain(DomainStart=minheight_2, DomainEnd=maxheight_2)
dom_6 = ConstructDomain(DomainStart=mindistance_2, DomainEnd=maxdistance_2)
random = Random(Range=dom, Number=count_2, Seed=2)
random_2 = Random(Range=dom_2, Number=count_2, Seed=2)
random_3 = Random(Range=dom_3, Number=count_2, Seed=2)
random_4 = Random(Range=dom_4, Number=count_2, Seed=2)
random_5 = Random(Range=dom_5, Number=count_2, Seed=2)
random_6 = Random(Range=dom_6, Number=count_2, Seed=2)
pt = ConstructPoint(XCoordinate=random, YCoordinate=random, ZCoordinate=0)
rectangle = Rectangle(Plane=pt, XSize=random_2, YSize=random_3, Radius=0)  # -> Rectangle, Length
rotate = Rotate(Geometry=rectangle.Rectangle, Angle=degrees(random_4), Plane=pt)  # -> Geometry, Transform
Z = UnitZ(Factor=random_5)
bnd = Bounds(Numbers=random_6)
moveaway = MoveAwayFrom(Geometry=rotate.Geometry, Emitter=rotate.Geometry, Distance=random_6)  # -> Geometry, Transform
remap = RemapNumbers(Value=random_6, Source=bnd, Target=Domain(0, 1))  # -> Mapped, Clipped
extr = Extrude(Base=moveaway.Geometry, Direction=Z)
runion = RegionUnion(Curves=moveaway.Geometry)
cap = CapHoles(Brep=extr)
mesh = MeshBrep(
    Brep=cap,
    Settings={GridMaxCount=0, GridMinCount=16, JaggedSeams=False, MaxEdgeLength=0, MinEdgeLength=0.0001, MinTolerance=0, Refine=True, RefineAngle=0, RelativeTolerance=0.65, SimplePlanes=True, Tolerance=0})
sunion = SolidUnion(Breps=cap)
area = Area(Geometry=runion)  # -> Area, Centroid
len = Length(Curve=runion)
gradient = Gradient(
    LowerLimit=0,
    UpperLimit=1,
    Parameter=remap.Mapped,
    stops=[0: RGB(0, 0, 139), 0.328: RGB(72, 61, 139), 0.703: RGB(123, 104, 238), 1: RGB(192, 192, 255), 1: RGB(230, 230, 250)])
volume = Volume(Geometry=sunion)  # -> Volume, Centroid
ma = MassAddition(Input=area.Area)  # -> Result, PartialResults
ma_2 = MassAddition(Input=len)  # -> Result, PartialResults
ma_3 = MassAddition(Input=volume.Volume)  # -> Result, PartialResults
demesh = DeconstructMesh(Mesh=mesh)  # -> Vertices, Faces, Colours, Normals
total_area = Panel(ma.Result)
panel = Panel("""residential
commercial
office
recreational
healthcare
educational
daycare
restaurant
hotel
industrial""")
total_perimeter = Panel(ma_2.Result)
total_volume = Panel(ma_3.Result)
conmesh = ConstructMesh(Vertices=demesh.Vertices, Faces=demesh.Faces, Colours=graft(gradient))  # -> flatten(Mesh)

# ---- group: RH_OUT:mesh
mesh_2 = Mesh(conmesh)
